# Grasshopper definition example.gh (Grasshopper 1.0.7)
# plug-ins: baues-toolbox Info, THERB-GH

windows_split = Surface([<surface referenced from the Rhino model> x3])
# step1. ジオメトリ、条件入力
rooms_split = Brep([<brep referenced from the Rhino model> x20])

# ----
# 北の方角を指定
vec = Vector()
brep = Brep([<brep referenced from the Rhino model> x3])
panel = Panel("exterior")
brep_2 = Brep([<brep referenced from the Rhino model> x2])
brep_3 = Brep([<brep referenced from the Rhino model> x3])
brep_4 = Brep([<brep referenced from the Rhino model> x2])
srf = Surface(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)
srf_2 = Surface(<surface referenced from the Rhino model>)
srf_3 = Surface(<surface referenced from the Rhino model>)
therb = THERB(Geometries=brep_3, Tolerance=Slider(0.1, range=0.1..10))  # -> Therb, Test
python = GhPythonScript(x=srf, y=Slider(0.61, range=0..1), z=Slider(0.25, range=0..1))  # -> out, a, b; inputs x: Surface
# ---------- python: Python ----------
u = x.Domain(0).ParameterAt(y)
v = x.Domain(1).ParameterAt(z)

a = x.PointAt(u, v)

b = x.Split(0, u)
# ---------- end python ----------
therb_2 = THERB(Geometries=brep_4, Windows=srf_3, Overhangs=srf_2, Tolerance=Slider(0.1, range=0..0.1))  # -> Therb, Test; disabled
# タスク13.fiterFaceByPropertyを実装
filterfacebyproperty = FilterFaceByProperty(Therb=therb_2.Therb, Bc=Slider(0, range=0..3), SurfT=-1, Direction=-1)  # -> TrueFace, FalseFace
item = ListItem(List=filterfacebyproperty.FalseFace, Index=Slider(1, range=0..2), Wrap=True)
readproperty = ReadProperty()
srf_4 = Surface(python.b)
item_2 = CherryPicker(therb.Test, ListIndex=0)
readproperty_2 = ReadProperty(Faces=item)  # -> PartId, Surface, ElementType, Normal, Direction, AdjacencyRoomId
digit_scroller = DigitScroller(Scroller_Digits=12, Scroller_Prefix="Index", Scroller_Radix=11, Scroller_Value=13)
python_2 = GhPythonScript(x=brep_4, y=srf_3)  # -> out, a; inputs x: list
# ---------- python_2: Python ----------
a = [x, y]
# ---------- end python_2 ----------
updateproperty = UpdateProperty(Face=filterfacebyproperty.TrueFace, Property=-1, Value=1)
exportb = ExportB(Therb=therb_2.Therb)
exporta = ExportA(Therb=therb_2.Therb)
exportr = ExportR(Therb=therb_2.Therb)
therb_3 = THERB(BDat=exportb, RDat=exportr, Name="TEST", Run=Toggle(False))
item_3 = ListItem(Index=digit_scroller, Wrap=True)

# ----
# step2. 出力をチェック
b_datファイル書き出し = Panel(exportb)
r_datファイル書き出し = Panel(exportr)
r_datファイル書き出し_2 = Panel(exporta)

# ----
# step03.
# サーバーにuploadする
# ための情報を入力
# step03-1. サーバーのドメイン入力
# (今のところ、ここは変える必要ないです）
# step03-2. プロジェクト名を入力
# step03-3. Trueにするとuploadして計算開始
panel_2 = Panel("http://localhost:5000/run")

uploadtherb = UploadTherb(Url=panel_2, ProjectName="demo2", Upload=Toggle(True))
# step04.
# サーバーからのresponseが表示されます。
# successとなっていれば、以下のurlをchrome
# で表示してください
# step05.
# 計算結果をPythonを利用してさらに分析することができます。
# 以下に分析例をまとめたJupyter Notebookを置いています。
# https://github.com/becat-oss/therb-notebook
panel_3 = Panel(uploadtherb)
